# Grasshopper definition unnamed1.gh (Grasshopper 1.0.7)

file_path = FilePath("C:\Users\86139\Desktop\assignment1\points.csv")
read_file = ReadFile(File=file_path, PerLineParse=True)
cull_index = CullIndex(List=read_file, Indices="0", Wrap=True)
text_split = TextSplit(Text=cull_index, Separators=",")
list_item = ListItem(List=text_split, Index="0", Wrap=True)  # -> Item, Item1
construct_point = ConstructPoint(XCoordinate=list_item.Item, YCoordinate=list_item.Item1, ZCoordinate=0)
